vi "index.gviweb"   [LabVIEW NXG 3.1.0]
panel indicators:
  "Temperature": f64
  "Relative Humidity": f64
uses:
  NI::HTTP::Open HTTP Handle.gvi
  NI::HTTP::GET.gvi
  NI::HTTP::Close HTTP Handle.gvi
diagram:
  call "Open HTTP Handle.gvi"() -> (client handle out=w1)
  s1 = w1  # shift register
  while {
    event (timeout = 500) {
      on Timeout {
        call "GET.gvi"(client handle=s1, url="http://192.168.43.2:8001/Demo/GetActualValues") -> (client handle out=w2, body=w3)
        Unflatten From JSON(JSON string=w3, type and defaults=cluster{"T": f64, "RH": f64} {all zero or empty}) -> (value=w4)
        Property Node(instance in=w4) -> ("T"=w5, "RH"=w6)
        $Temperature <- w5
        $"Relative Humidity" <- w6
      }
    }
    next s1 = w2
    stop if FALSE
  }
  call "Close HTTP Handle.gvi"(client handle=s1)
