vi "GetActualValues.gvi"   [LabVIEW NXG 3.1.0]
inputs:
  "client handle": "Client Handle.gtype"
  "BaseURL": string
  "error in": error
outputs:
  "client handle out": "Client Handle.gtype"
  "ActualValues": "ActualValues.gtype"
  "error out": error
types:
  "Client Handle.gtype" = u32
  "ActualValues.gtype" = cluster{"Time": f64, "Temp": f64, "RH": f64}
uses:
  NI::HTTP::GET.gvi
diagram:
  case ($"error in") {
    frame Error, Default {
      w1 = $"client handle"
      w2 = default
      w3 = $"error in"
    }
    frame No Error {
      Format Into String(formatString="%s%s", errIn=$"error in", $BaseURL, "GetActualValues") -> (outString=w4, errOut=w5)
      # Example: http://192.168.178.191:8002/IndoorMonitoring/GetActualValues
      call "GET.gvi"(client handle=$"client handle", url=w4, error in=w5) -> (client handle out=w1, body=w6, error out=w7)
      w8 = "ActualValues.gtype" {all zero or empty}  # ActualValues_Cte
      Unflatten From JSON(JSON string=w6, error in (no error)=w7, type and defaults=w8) -> (error out=w3, value=w2)
    }
  }
  $"client handle out" <- w1
  $ActualValues <- w2
  $"error out" <- w3
