vi "UIFunctions_init.gvi"   [LabVIEW NXG 3.1.0]
inputs:
  "Error In": error
  "Ip adresses of nodes": string[] = ["192.168.178.67", "192.168.178.144", "192.168.178.191"], required
  "ListBoxRef": "Listbox reference", required
outputs:
  "Error Out": error
  "UIFunction_Out": "UI_FunctionProps.gtype"
types:
  "Client Handle.gtype" = u32
  "UI_FunctionProps.gtype" = cluster{"HTTP_BaseStrings": string[], "HTTP client handle": "Client Handle.gtype", "NodesOnline": bool[], "ListBoxRef": "Listbox reference"}
uses:
  NI::HTTP::Open HTTP Handle.gvi
  WebApp::NodeCommunication::GetDebug.gvi
diagram:
  case ($"Error In") {
    frame Error, Default {
      w1 = $"Error In"
      w2 = "UI_FunctionProps.gtype" {all zero or empty}
    }
    frame No Error {
      w3 = "http://%s:8001/IndoorMonitoring/"  # Base string without IP
      for {
        w4 = each element of $"Ip adresses of nodes"
        Format Into String(formatString=w3, w4) -> w6
        append w6 to w5
      }
      call "Open HTTP Handle.gvi"(error in=$"Error In") -> (client handle out=w7, error out=w1)
      s1 = w7  # shift register
      for {
        w8 = each element of w5
        call "GetDebug.gvi"(client handle=s1, BaseURL=w8) -> (client handle out=w10, error out=w11)
        Property Node(instance in=w11) -> ("status"=w12)
        append w12 to w9
        next s1 = w10
      }
      Not(x=w9) -> w13
      Property Node(instance in="UI_FunctionProps.gtype" {all zero or empty}, "ListBoxRef"=$ListBoxRef, "HTTP_BaseStrings"=w5, "HTTP client handle"=s1, "NodesOnline"=w13) -> (instance out=w2)
    }
  }
  $UIFunction_Out <- w2
  $"Error Out" <- w1
