vi "index.gviweb"   [LabVIEW NXG 3.1.0]
panel controls:
  "Tab": i32
  "Node Files 1": i32 = -1
panel indicators:
  "NodeTemp1": f64
  "NodeRH1": f64
  "String Info Node 1": string
  "status": bool
  "AVG T Graphs": cluster{"Element 1": f64[], "Element 2": f64[]}[]
  "Update Time": string
  "T HistMinMax": cluster{"Element 1": f64[], "Element 2": f64[]}[]
  "T summary node 1": string
  "RH summary node 1": string
  "AVG RH Graphs": cluster{"Element 1": f64[], "Element 2": f64[]}[]
  "File T Graphs": cluster{"Element 1": f64[], "Element 2": f64[]}[]
  "File RH Graphs": cluster{"Element 1": f64[], "Element 2": f64[]}[]
  "RH HistMinMax": cluster{"Element 1": f64[], "Element 2": f64[]}[]
uses:
  WebApp::UI_Functions::UIFunctions_init.gvi
  WebApp::UI_Functions::UIFunctions_GetDebug.gvi
  WebApp::UI_Functions::UIFunctions_GetActualValues.gvi
  WebApp::UI_Functions::UIFunctions_GetAveragedValues.gvi
  WebApp::UI_Functions::UIFunctions_GetFileList.gvi
  WebApp::UI_Functions::UIFunctions_GetMinMaxValues.gvi
  WebApp::UI_Functions::UIFunctions_GetFileData.gvi
diagram:
  Property Node(instance in=reference to "Tab", "Value"=0) -> (instance out=w1)
  call "UIFunctions_init.gvi"(Ip adresses of nodes=["192.168.43.2"], ListBoxRef=reference to "Node Files 1") -> (UIFunction_Out=w2)
  s1 = w2  # shift register
  s2 = 10  # shift register
  while (after w1) {
    w3 = $Tab
    event (timeout = s2) (after w3) {
      on Timeout {
        Get Date And Time String(want seconds? (F)=TRUE) -> (time string=w7)
        call "UIFunctions_GetDebug.gvi"(UIFunction_In=s1) -> (UIFunction_Out=w8, DebugStrings=w9, Error Out=w10)
        Array Index(array=w9) -> (out0[_]=w11)
        $"String Info Node 1" <- w11
        call "UIFunctions_GetActualValues.gvi"(UIFunction_In=w8, Error In=w10) -> (UIFunction_Out=w12, ActualValues=w13, Error Out=w14)
        Array Index(array=w13) -> (out0[_]=w15, out1[_]=w16, out2[_]=w17)
        Property Node(instance in=w15) -> ("Temp"=w18, "RH"=w19)
        $NodeTemp1 <- w18
        $NodeRH1 <- w19
        Property Node(instance in=w16)
        call "UIFunctions_GetAveragedValues.gvi"(UIFunction_In=w12, Error In=w14) -> (UIFunction_Out=w4, T Graphs=w20, RH Graphs=w21, Error Out=w5)
        $"AVG T Graphs" <- w20
        $"AVG RH Graphs" <- w21
        Property Node(instance in=w17)
        w6 = 15000
      }
      on "Tab" Value changed {
        Get Date And Time String(want seconds? (F)=TRUE) -> (time string=w7)
        Event Data() -> ("New Value"=w22)
        case (w22) {
          frame 0, Default {
            w4 = s1
            w5 = default
          }
          frame 1 {
            # Update the file list of each node
            call "UIFunctions_GetFileList.gvi"(UIFunction_In=s1) -> (UIFunction_Out=w4, Error Out=w5)
          }
          frame 2, 3 {
            call "UIFunctions_GetMinMaxValues.gvi"(UIFunction_In=s1) -> (UIFunction_Out=w4, T Graphs=w23, RH Graphs=w24, Error Out=w5, T Strings=w25, RH Strings=w26)
            # Get the hostorical min and max for each node - takes some time to process
            Array Index(array=w25) -> (out0[_]=w27)
            $"T summary node 1" <- w27
            Array Index(array=w26) -> (out0[_]=w28)
            $"RH summary node 1" <- w28
            $"T HistMinMax" <- w23
            $"RH HistMinMax" <- w24
          }
        }
        w6 = s2
      }
      on "Node Files 1" Value changed {
        Get Date And Time String(want seconds? (F)=TRUE) -> (time string=w7)
        call "UIFunctions_GetFileData.gvi"(UIFunction_In=s1) -> (UIFunction_Out=w4, T Graphs=w29, RH Graphs=w30, Error Out=w5)
        $"File T Graphs" <- w29
        $"File RH Graphs" <- w30
        w6 = s2
      }
    }
    $"Update Time" <- w7
    Property Node(instance in=w5) -> ("status"=w31)
    $status <- w31
    next s1 = w4
    next s2 = w6
    stop if FALSE
  }
